# Grasshopper definition Docker_Swiftlet.gh (Grasshopper 1.0.7)
# plug-ins: Swiftlet

cqp = CreateQueryParam(Key="blur_kernel_size", Value=Slider(15, range=0..100))
cqp_2 = CreateQueryParam(Key="threshold_background", Value=Slider(127, range=0..1000))
cqp_3 = CreateQueryParam(Key="threshold_knots", Value=Slider(60, range=0..100))
cqp_4 = CreateQueryParam(Key="opening_kernel_size", Value=Slider(7, range=0..10))
cqp_5 = CreateQueryParam(Key="opening_iterations", Value=Slider(5, range=0..10))

merge = Merge(Data1=cqp, Data2=cqp_2, Data3=cqp_3, Data4=cqp_4, Data5=cqp_5)
get = GETRequest(URL="http://127.0.0.1:8000/", Params=merge)  # -> Status, Content, Response
panel = Panel(get.Status)
panel_2 = Panel(get.Response)
pjs = ParseJSONString(Text=get.Content)
rja = ReadJSONArray(Array=pjs)
rja_2 = ReadJSONArray(Array=rja)
rja_3 = ReadJSONArray(Array=rja_2)
rja_4 = ReadJSONArray(Array=rja_3)
rja_5 = ReadJSONArray(Array=rja_4)
rjv = ReadJSONValue(JValue=rja_5)  # -> AsString, AsNumber, AsBool
num2pt = NumbersToPoints(Numbers=rjv.AsNumber, Mask=2)  # -> simplify(Points)
trim = TrimTree(Tree=num2pt, Depth=1)
pline = PolyLine(Vertices=trim, Closed=invert(False))
smoothpline = SmoothPolyline(Polyline=pline, Strength=1, Times=Slider(2, range=0..10))
